# Grasshopper definition OpenLB.ghx (Grasshopper 1.0.8)
# plug-ins: Eddy3D-Lbm, Outdoor

atmospheric_boundary_layer = AtmosphericBoundaryLayer(
    ReferenceHeight=10,
    RoughnessLengthZ0=1,
    GroundHeight=0,
    TurbulentKEK=0.015,
    TurbulentEpsilonΕ=0.135,
    TurbulentOmegaΩ=100)  # -> BoundaryConditions, WindVectors, AirABLSettings
geometry = Geometry(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)
lbm_run_settings = LBMRunSettings(GridSpacing=1, Warmup=60, Averaging=120, ProbeHeight=1.5, ProbeSpacing=2, GPU=True, Runtime="Auto")
lbm_run = LBMRun(
    Buildings=geometry,
    ABL=atmospheric_boundary_layer.BoundaryConditions,
    Settings=lbm_run_settings,
    Prepare=False,
    Run=False)  # -> Logs, Case
lbm_field = LBMField(Case=lbm_run.Case, Refresh=Button())  # -> Points, Velocity, Speed, Status
panel = Panel(lbm_run.Logs)
bounds = Bounds(Numbers=lbm_field.Speed)
deconstruct_domain = DeconstructDomain(Domain=bounds)  # -> Start, End
gradient = Gradient(
    LowerLimit=deconstruct_domain.Start,
    UpperLimit=deconstruct_domain.End,
    Parameter=lbm_field.Speed,
    stops=[0: RGB(48, 18, 59), 0.0294: RGB(56, 40, 112), 0.0588: RGB(63, 62, 156), 0.0882: RGB(68, 82, 193), 0.118: RGB(70, 102, 221), 0.147: RGB(71, 122, 241)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])
vector_display_ex = VectorDisplayEx(Point=lbm_field.Points, Vector=lbm_field.Velocity, Colour=gradient, Width=2)
