# Grasshopper definition Sun_Hours.ghx (Grasshopper 1.0.8)
# plug-ins: Outdoor, Eddy3D, Eddy3D-Radiance

geometry = Geometry(<surface referenced from the Rhino model>)
brep_grid_points = BrepGridPoints(Geometry=geometry, Spacing="4")  # -> Points, Vectors, Mesh, Status
download_weather = DownloadWeather(Search="Atlanta")  # -> EPWFile, Logs, Stations
geometry_2 = Geometry([<brep referenced from the Rhino model> x88])
deconstruct_mesh = DeconstructMesh(Mesh=brep_grid_points.Mesh)  # -> Vertices, Faces, Colours, Normals
deconstruct_weather = DeconstructWeather(Weather=download_weather.EPWFile, Series="""Solar Elevation
Solar Azimuth
Latitude
Longitude""")  # -> SolarElevation, SolarAzimuth, Latitude, Longitude
mjoin = MeshJoin(Meshes=geometry_2)
sun_hours = SunHours(
    Context=mjoin,
    Points=deconstruct_mesh.Vertices,
    SunElevation=deconstruct_weather.SolarElevation,
    SunAzimuth=deconstruct_weather.SolarAzimuth,
    StartHour=0,
    EndHour=8760,
    Offset=0.01)  # -> SunHours, Fraction, Colors, Report
panel = Panel(sun_hours.Report)

# ---- group: Mean
bnd = Bounds(Numbers=sun_hours.SunHours)
dedomain = DeconstructDomain(Domain=bnd)  # -> Start, End
gradient = Gradient(
    LowerLimit=dedomain.Start,
    UpperLimit=dedomain.End,
    Parameter=sun_hours.SunHours,
    stops=[0: RGB(48, 18, 59), 0.0294: RGB(56, 40, 112), 0.0588: RGB(63, 62, 156), 0.0882: RGB(68, 82, 193), 0.118: RGB(70, 102, 221), 0.147: RGB(71, 122, 241)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])

# ----
construct_mesh = ConstructMesh(Vertices=deconstruct_mesh.Vertices, Faces=deconstruct_mesh.Faces, Colours=gradient)
